# Grasshopper definition Chrysalis.gh (Grasshopper 1.0.7)

# ---- group: Création des extrémités des arcs
portée = Slider(34, range=20..40)
creation_des_2_points = CreationDes2Points(X=portée)  # -> pt_4, pt_3

# ---- group: Tracé des arcs
flèche_arc_1 = Slider(55, range=50..60)
position_arc_1 = Slider(-0.891, range=-1..-0.6)
epaisseur_arcs = Slider(0.16, range=0.1..0.4)
flèche_arc_2 = Slider(50, range=45..60)
position_arc_3 = Slider(0.342, range=0.1..0.4)
flèche_arc_3 = Slider(47, range=45..60)
position_arc_2 = Slider(-0.295, range=-0.4..-0.1)
flèche_arc_4 = Slider(50, range=45..60)
position_arc_4 = Slider(0.814, range=0.6..1)
arcs = Arcs(
    A=creation_des_2_points.pt_4,
    B=creation_des_2_points.pt_3,
    L=[flèche_arc_1, flèche_arc_2, flèche_arc_3, flèche_arc_4],
    Y=[position_arc_1, position_arc_2, position_arc_3, position_arc_4])
pipe = Pipe(Curve=arcs, Radius=epaisseur_arcs, Caps=0)

# ---- group: Tracé des liens entre les arcs
courbure_liens_1 = Slider(0.896, range=0..1.3)
courbure_liens_3 = Slider(7.02, range=2..9)
courbure_liens_2 = Slider(4.973, range=2..6)
nombre_de_liens = Slider(61, range=5..100)
epaisseur_liens = Slider(0.043, range=0.01..0.1)
division_arcs = DivisionArcs(L=arcs, N=nombre_de_liens)  # -> D, D_3, D_2, D_5, D_8, D_4, D_6, D_7
liens = Liens(
    Y=[courbure_liens_1, courbure_liens_2, courbure_liens_3],
    S_2=division_arcs.D,
    S_3=division_arcs.D_2,
    S=division_arcs.D_8,
    E=division_arcs.D_6,
    S_5=division_arcs.D_3,
    S_4=division_arcs.D_5,
    E_2=division_arcs.D_4,
    E_3=division_arcs.D_7)
pipe_2 = Pipe(Curve=liens, Radius=epaisseur_liens, Caps=0)

# ==== cluster DivisionArcs

# ---- group: Division des arcs
# Division arcs
# Liste de arcs
# Number slider nombre de liens
L = ClusterInput()
N = ClusterInput()
item = ListItem(List=L, Index=1, Wrap=True)
item_2 = ListItem(List=L, Index=0, Wrap=True)
item_3 = ListItem(List=L, Index=3, Wrap=True)
item_4 = ListItem(List=L, Index=2, Wrap=True)
divide = DivideCurve(Curve=item_2, Count=N, Kinks=False)  # -> Points, Tangents, Parameters
divide_2 = DivideCurve(Curve=item, Count=N, Kinks=False)  # -> Points, Tangents, Parameters
divide_3 = DivideCurve(Curve=item_3, Count=N, Kinks=False)  # -> Points, Tangents, Parameters
divide_4 = DivideCurve(Curve=item_4, Count=N, Kinks=False)  # -> Points, Tangents, Parameters

# ---- group: Décalage des points résultant de la division des arcs
shift = ShiftList(List=divide.Points, Shift=expr("x-1", 1), Wrap=False)
shift_2 = ShiftList(List=divide_4.Points, Shift=expr("x-3", 1), Wrap=False)
shift_3 = ShiftList(List=divide_4.Points, Shift=expr("x+3", 1), Wrap=False)
shift_4 = ShiftList(List=divide_3.Points, Shift=expr("x-4", 1), Wrap=False)
shift_5 = ShiftList(List=divide_3.Points, Shift=expr("x+4", 1), Wrap=False)
shift_6 = ShiftList(List=divide.Points, Shift=expr("x+1", 1), Wrap=False)
shift_7 = ShiftList(List=divide_2.Points, Shift=expr("x-2", 1), Wrap=False)
shift_8 = ShiftList(List=divide_2.Points, Shift=expr("x+2", 1), Wrap=False)
rev = ReverseList(List=shift_4)
rev_2 = ReverseList(List=shift_2)
rev_3 = ReverseList(List=shift)
rev_4 = ReverseList(List=shift_7)
flip = FlipMatrix(Data=rev_3)
flip_2 = FlipMatrix(Data=shift_6)
flip_3 = FlipMatrix(Data=rev_4)
flip_4 = FlipMatrix(Data=shift_3)
flip_5 = FlipMatrix(Data=shift_8)
flip_6 = FlipMatrix(Data=rev)
# Liste des numéros dans l'ordre
flip_7 = FlipMatrix(Data=shift_5)
flip_8 = FlipMatrix(Data=rev_2)
D = ClusterOutput(flip)
D_2 = ClusterOutput(flip_3)
D_3 = ClusterOutput(flip_2)
D_4 = ClusterOutput(flip_4)
D_5 = ClusterOutput(flip_5)
D_6 = ClusterOutput(flip_6)
D_7 = ClusterOutput(flip_7)
D_8 = ClusterOutput(flip_8)

# ==== cluster CreationDes2Points
# Number slider portée
X = ClusterInput()
# Création des extrémités
pt = ConstructPoint(XCoordinate=0, YCoordinate=0, ZCoordinate=0)
pt_2 = ConstructPoint(XCoordinate=X, YCoordinate=0, ZCoordinate=0)
# Extrémité 2
pt_3 = ClusterOutput(pt_2)
# Extrémité 1
pt_4 = ClusterOutput(pt)

# ==== cluster Liens

# ---- group: Paramétrage courbures
# Création des liens
# Number slider courbure
Y = ClusterInput()
vec = VectorXYZ(XComponent=0, YComponent=Y, ZComponent=1)  # -> Vector, Length
item = ListItem(List=vec.Vector, Index=0, Wrap=True)
item_2 = ListItem(List=vec.Vector, Index=1, Wrap=True)
item_3 = ListItem(List=vec.Vector, Index=2, Wrap=True)

# ---- group: Tracé liens (décalage positif des points)
# Liste des points de l'arc 1
# Liste des points de l'arc 2
# Liste des points de l'arc 3
# Liste des points de l'arc 4
S = ClusterInput()
S_2 = ClusterInput()
E = ClusterInput()
S_3 = ClusterInput()
arc = ArcSED(Start=S_2, End=S_3, Direction=item)  # -> Arc, Plane, Radius
arc_2 = ArcSED(Start=S_3, End=S, Direction=item_2)  # -> Arc, Plane, Radius
arc_3 = ArcSED(Start=S, End=E, Direction=item_3)  # -> Arc, Plane, Radius

# ---- group: Tracé liens (décalage négatif des points)
# Liste des points de l'arc 1 à l'envers
# Liste des points de l'arc 2 à l'envers
# Liste des points de l'arc 3 à l'envers
# Liste des points de l'arc 4 à l'envers
S_4 = ClusterInput()
S_5 = ClusterInput()
E_2 = ClusterInput()
E_3 = ClusterInput()
arc_4 = ArcSED(Start=S_5, End=S_4, Direction=item)  # -> Arc, Plane, Radius
arc_5 = ArcSED(Start=S_4, End=E_2, Direction=item_2)  # -> Arc, Plane, Radius
arc_6 = ArcSED(Start=E_2, End=E_3, Direction=item_3)  # -> Arc, Plane, Radius

# ----
# Listes des liens
A = ClusterOutput([arc_2.Arc, arc.Arc, arc_3.Arc, arc_4.Arc, arc_5.Arc, arc_6.Arc])

# ==== cluster Arcs
# Number slider flèche
L = ClusterInput()
# Number slider position
Y = ClusterInput()
# Arcs
# Extrémité 1
# Extrémité 2
A = ClusterInput()
B = ClusterInput()
vec = VectorXYZ(XComponent=0, YComponent=Y, ZComponent=1)  # -> Vector, Length
cat = Catenary(PointA=A, PointB=B, Length=L, Gravity=vec.Vector)
# Liste des arcs
C = ClusterOutput(cat)
